# Dynamo graph DYN-Populate_info_closest_room.dyn "MCORM-DYN-Populate_info_closest_room_v2" (Dynamo 2.16.2.5624)

categories = Categories("OST_StairsRailing")  # graph input
all_elements_of_category = ElementsOfCategory(Category=categories)
categories_2 = Categories("OST_Rooms")  # graph input
all_elements_of_category_2 = ElementsOfCategory(Category=categories_2)
code_block = CodeBlock { "ContainingSpaceNumber"; }
python_script = Python(IN[0]=all_elements_of_category, IN[1]=all_elements_of_category_2, IN[2]=code_block)  # CPython3
# ---------- python_script.python (76 lines) ----------
import clr
clr.AddReference('RevitAPI')
clr.AddReference('RevitServices')
from Autodesk.Revit.DB import *
from RevitServices.Persistence import DocumentManager
from RevitServices.Transactions import TransactionManager

# Get the active document from Revit
doc = DocumentManager.Instance.CurrentDBDocument

# Inputs from Dynamo (assumed to be provided via input ports in the Python script node)
curtain_panels = UnwrapElement(IN[0])  # UnwrapElement is necessary to work with Revit elements
rooms = UnwrapElement(IN[1])
parameter_name = IN[2]  # The parameter name where the room number will be stored

def get_center(element):
    # This function retrieves the center point of an element's bounding box
    bbox = element.get_BoundingBox(None)
    if bbox:
        center_x = (bbox.Min.X + bbox.Max.X) / 2
        center_y = (bbox.Min.Y + bbox.Max.Y) / 2
        center_z = (bbox.Min.Z + bbox.Max.Z) / 2
        return XYZ(center_x, center_y, center_z)
    return None

def find_closest_room(panel_point, panel_level, rooms, rooms_points, room_levels):
    # Find the closest room on the same level based on Euclidean distance
    min_distance = float('inf')
    closest_room = None
    for room, room_point, room_level in zip(rooms, rooms_points, room_levels):
        if not room_point or room_level != panel_level:
            continue  # Skip rooms not on the same level
        distance = panel_point.DistanceTo(room_point)
        if distance < min_distance:
            min_distance = distance
            closest_room = room
    return closest_room

# Get center points of curtain panels and rooms
curtain_panel_points = [get_center(panel) for panel in curtain_panels]
room_points = [get_center(room) for room in rooms]

# Get levels of curtain panels and rooms
curtain_panel_levels = [panel.LevelId for panel in curtain_panels]
room_levels = [room.LevelId for room in rooms]

# Start a transaction to modify the document
TransactionManager.Instance.EnsureInTransaction(doc)

try:
    # Find the closest room for each panel and set the parameter
    for panel, panel_point, panel_level in zip(curtain_panels, curtain_panel_points, curtain_panel_levels):
        if not panel_point:
            continue
        
        closest_room = find_closest_room(panel_point, panel_level, rooms, room_points, room_levels)
        if closest_room:
            room_number = closest_room.LookupParameter("Number")
            if room_number and room_number.HasValue:
                panel_param = panel.LookupParameter(parameter_name)
                if panel_param and not panel_param.IsReadOnly:
                    panel_param.Set(room_number.AsString())
                else:
                    OUT = f"Parameter '{parameter_name}' not found or is read-only for panel {panel.Id}."
                    break
            else:
                OUT = f"No room number found for room {closest_room.Id}."
                break
    else:
        OUT = "Room numbers successfully assigned to curtain panels."

except Exception as e:
    OUT = f"An error occurred: {str(e)}"

# Commit the transaction to finalize changes
TransactionManager.Instance.TransactionTaskDone()
# ----------------------------------------
watch = Watch(python_script)
getLocation = Element.GetLocation(element=all_elements_of_category_2)
flatten = List.Flatten(list=getLocation)
watch_2 = Watch(flatten)
