# Dynamo graph Exercise.dyn (Dynamo 2.16.2.5624)

python_script = Python()  # CPython3; unwired: IN[0]
# ---------- python_script.python (41 lines) ----------
# Import necessary libraries
import clr

# Import Revit API and Dynamo-Revit Interop libraries
clr.AddReference("RevitServices")
from RevitServices.Persistence import DocumentManager
from RevitServices.Transactions import TransactionManager

clr.AddReference("RevitAPI")
from Autodesk.Revit.DB import *

# Get the current Revit document
doc = DocumentManager.Instance.CurrentDBDocument

# Filter to get all wall elements in the project
wall_collector = FilteredElementCollector(doc).OfClass(Wall)

# Prepare a list to store wall information
wall_data = []

# Loop through each wall and retrieve its parameters
for wall in wall_collector:
    wall_info = {"Name": wall.Name, "Parameters": {}}
    
    # Loop through parameters of the wall
    for param in wall.Parameters:
        if param.HasValue:
            # Get parameter name and value
            param_name = param.Definition.Name
            try:
                param_value = param.AsString() or param.AsValueString()
            except:
                param_value = "N/A"
            # Store parameter data
            wall_info["Parameters"][param_name] = param_value
    
    # Add wall info to the wall_data list
    wall_data.append(wall_info)

# Output the list of wall data
OUT = wall_data
# ----------------------------------------
watch = Watch(python_script)
