# Dynamo graph Sample dynamo script.dyn (Dynamo 2.16.2.5624)

python_script = Python()  # CPython3; unwired: IN[0]
# ---------- python_script.python (8 lines) ----------
# Import required library
import clr

# Print "Hello" as the output
output = "Hello"

# Assign the output to the OUT variable
OUT = output
# ----------------------------------------
watch = Watch(python_script)
